# Grasshopper definition Mapping.gh (Grasshopper 1.0.7)

pt = Point([<point referenced from the Rhino model> x47])
points = PointList(Points=pt, Size=Slider(2, range=0..10))
item = ListItem(List=pt, Index=Slider(60, range=0..100), Wrap=True)
pdecon = Deconstruct(Point=pt)  # -> XComponent, YComponent, ZComponent
panel = Panel(pdecon.ZComponent)
panel_2 = Panel(pdecon.XComponent)
panel_3 = Panel(pdecon.YComponent)
format = Format(Format="[{0},{1},{2}]", Culture=127, Data0=pdecon.XComponent, Data1=pdecon.YComponent, Data2=pdecon.ZComponent)
concat = Concatenate(FragmentA="{", FragmentB=panel_2)
panel_4 = Panel(format)
join = TextJoin(Text=panel_4, Join=",")
rec = DataRecorder(DataLimit=-10, RecordData=True)
panel_5 = Panel(join)
format_2 = Format(Format="[{0}]", Culture=127, Data0=panel_5)
panel_6 = Panel(format_2)
